# Grasshopper definition solarAnalysis.gh (Grasshopper 1.0.7)
# plug-ins: BH.UI.Grasshopper

location = Location(
    Latitude=Slider(26, range=0..100),
    Longitude=Slider(30, range=0..100),
    Elevation=0,
    UtcOffset=Slider(2, range=0..10),
    Name="Kyiv",
    Component="BH.oM.Environment.Climate.Location")
createobject = CreateObject(Component="{ \"SelectedItem\" : null, \"InputParams\" : [], \"OutputParams\" : [], \"BHoM_Guid\" : \"049152e5-8408-4a3c-b745-25fb2567f623\" }")
spacetime = SpaceTime(
    Location=location,
    Year=Slider(2020, range=0..10000),
    Month=Slider(2, range=0..10),
    Day=Slider(23, range=0..100),
    Hour=Slider(14, range=0..100),
    Component="BH.oM.Environment.Climate.SpaceTime")
compute = Compute(Component="{ \"SelectedItem\" : null, \"InputParams\" : [], \"OutputParams\" : [], \"BHoM_Guid\" : \"aac63dae-9378-4df4-b21e-1d2591a10e29\" }")
solarposition = SolarPosition(SpaceTime=spacetime, Component="{ .SolarPosition")
dailypath = DailyPath(SpaceTime=spacetime, Component="{ .DailyPath")
line = LineSDL(Start="0,0,0", Direction=Vector(0, 0, 1), Length=Slider(500, range=0..1000))
explode = Explode(Object=solarposition, Component="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")  # -> Azimuth, Altitude, Sunrise, Sunset, BHoM_Guid, Name, Fragments, Tags, CustomData
getproperty = GetProperty(PropName="Azimuth", Component="{ .GetProperty")
